% Simulink data dictionary ModelDictionary.sldd

angleHip = [0.1886164; 0.188616; 0.188615; 0.1886133; 0.1886109; 0.1886079; 0.1886041; 0.1885997; 0.1885946; 0.1885889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 0.1886382]
angleKnee = [0; 2.6865e-06; 1.073272e-05; 2.411876e-05; 4.28247e-05; 6.683063e-05; 9.611665e-05; 0.0001306628; 0.0001704493; 0.000215456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 6.471225e-05]

EtherCATReceivedFromBMS = Simulink.Bus()
  stateBMS: double
  statusChargeBattery: double
  statusTemperatureBattery: double
  minVoltCell: double
  maxVoltCell: double

EtherCATReceivedFromInputDevice = Simulink.Bus()
  desiredState: double
  error: double

EtherCATReceivedFromPDB = Simulink.Bus()
  statePDB: double
  statusCurrentBattery: double
  statusVoltageBattery: double
  statusTemperatureDCDC: double

EtherCATReceivedFromPowerElectronics = Simulink.Bus()
  receivedFromPDB: Bus: EtherCATReceivedFromPDB
  receivedFromBMS: Bus: EtherCATReceivedFromBMS

EtherCATSendToInputDevice = Simulink.Bus()
  state: double
  message: double

EtherCATSendToPDB = Simulink.Bus()
  masterOP: double

EtherCATSendToPowerElectronics = Simulink.Bus()
  sendToPDB: Bus: EtherCATSendToPDB

GaitGeneratorInput = Simulink.Bus()
  targetLeg: Enum: Leg
  stepType: Enum: StepType

JointDynamics = Simulink.Bus()
  angle: double
  velocity: double
  torque: double

PowerElectronicsError = Simulink.Bus()
  errorPDB: double
  errorBMS: double

JointControlConfigLHFE = struct(
  angleOffset=1245,
  polePairs=21,
  minPosLimit=-134.9,
  maxPosLimit=-86.2,
  maxSpeed=60,
  maxTorque=2.122,
  positionKp=500000,
  positionKi=0,
  positionKd=0,
  positionIntegralLimit=2122,
  velocityKp=600000,
  velocityKi=10000,
  velocityKd=0,
  velocityIntegralLimit=2122,
  brakeReleaseStrategy=0)

JointControlConfigLHFE_Param = Simulink.Parameter(struct(
  angleOffset=1245,
  polePairs=21,
  minPosLimit=-200,
  maxPosLimit=200,
  maxSpeed=60,
  maxTorque=2.122,
  positionKp=500000,
  positionKi=0,
  positionKd=0,
  positionIntegralLimit=2122,
  velocityKp=600000,
  velocityKi=10000,
  velocityKd=0,
  velocityIntegralLimit=2122,
  brakeReleaseStrategy=0), DataType="Bus: JointControlConfig")

JointControlConfigLKFE = struct(
  angleOffset=1245,
  polePairs=21,
  minPosLimit=-134.9,
  maxPosLimit=-86.2,
  maxSpeed=60,
  maxTorque=2.122,
  positionKp=500000,
  positionKi=0,
  positionKd=0,
  positionIntegralLimit=2122,
  velocityKp=600000,
  velocityKi=10000,
  velocityKd=0,
  velocityIntegralLimit=2122,
  brakeReleaseStrategy=0)

JointControlConfigLKFE_Param = Simulink.Parameter(struct(
  angleOffset=1245,
  polePairs=21,
  minPosLimit=-200,
  maxPosLimit=200,
  maxSpeed=60,
  maxTorque=2.122,
  positionKp=500000,
  positionKi=0,
  positionKd=0,
  positionIntegralLimit=2122,
  velocityKp=600000,
  velocityKi=10000,
  velocityKd=0,
  velocityIntegralLimit=2122,
  brakeReleaseStrategy=0), DataType="Bus: JointControlConfig")

JointControlConfigRHFE = struct(
  angleOffset=1245,
  polePairs=21,
  minPosLimit=-134.9,
  maxPosLimit=-86.2,
  maxSpeed=60,
  maxTorque=2.122,
  positionKp=500000,
  positionKi=0,
  positionKd=0,
  positionIntegralLimit=2122,
  velocityKp=600000,
  velocityKi=10000,
  velocityKd=0,
  velocityIntegralLimit=2122,
  brakeReleaseStrategy=0)

JointControlConfigRHFE_Param = Simulink.Parameter(struct(
  angleOffset=1245,
  polePairs=21,
  minPosLimit=-200,
  maxPosLimit=200,
  maxSpeed=60,
  maxTorque=2.122,
  positionKp=500000,
  positionKi=0,
  positionKd=0,
  positionIntegralLimit=2122,
  velocityKp=600000,
  velocityKi=10000,
  velocityKd=0,
  velocityIntegralLimit=2122,
  brakeReleaseStrategy=0), DataType="Bus: JointControlConfig")

JointControlConfigRKFE = struct(
  angleOffset=1245,
  polePairs=21,
  minPosLimit=-134.9,
  maxPosLimit=-86.2,
  maxSpeed=60,
  maxTorque=2.122,
  positionKp=500000,
  positionKi=0,
  positionKd=0,
  positionIntegralLimit=2122,
  velocityKp=600000,
  velocityKi=10000,
  velocityKd=0,
  velocityIntegralLimit=2122,
  brakeReleaseStrategy=0)

JointControlConfigRKFE_Param = Simulink.Parameter(struct(
  angleOffset=1245,
  polePairs=21,
  minPosLimit=-200,
  maxPosLimit=200,
  maxSpeed=60,
  maxTorque=2.122,
  positionKp=500000,
  positionKi=0,
  positionKd=0,
  positionIntegralLimit=2122,
  velocityKp=600000,
  velocityKi=10000,
  velocityKd=0,
  velocityIntegralLimit=2122,
  brakeReleaseStrategy=0), DataType="Bus: JointControlConfig")

resolutionJointEncoder = Simulink.Parameter(65536, DataType="double")
maxAngle = Simulink.Parameter(6.283185, Unit="Rad")
maxNonResponsive = Simulink.Parameter(0.3, Unit="seconds")
maxTemperature = Simulink.Parameter(120, Unit="Degrees")
maxPhasePeakCurrent = Simulink.Parameter(70, Unit="A")
maxTorque = Simulink.Parameter(2.122, Unit="Nm")
maxVelocity = Simulink.Parameter([], Unit="Rad/s")
currentTimeMaximum = Simulink.Parameter(40, Unit="A")
currentMaximum = Simulink.Parameter(35, Unit="A")
maxAngleDiff = Simulink.Parameter(0.2, Unit="Rad")
maxVelocityDiff = Simulink.Parameter(0.5, Unit="Rad/s")
minAngle = Simulink.Parameter(-1.2566, Unit="Rad")
zeroOffsetLHFE = Simulink.Parameter(0, Unit="Rad")
zeroOffsetRHFE = Simulink.Parameter(0, Unit="Rad")
zeroOffsetLKFE = Simulink.Parameter(0, Unit="Rad")
zeroOffsetRKFE = Simulink.Parameter(0, Unit="Rad")
maxPositionDifference = Simulink.Parameter(0.1745, Unit="Rad")

JointControlConfig = Simulink.Bus()
  angleOffset: double
  polePairs: double
  minPosLimit: double
  maxPosLimit: double
  maxSpeed: double
  maxTorque: double
  positionKp: double
  positionKi: double
  positionKd: double
  positionIntegralLimit: double
  velocityKp: double
  velocityKi: double
  velocityKd: double
  velocityIntegralLimit: double
  brakeReleaseStrategy: double

EtherCATReceivedFromGESJoint = Simulink.Bus()
  temperature: double

EtherCATData = Simulink.Bus()
  receivedFromSOMANETs: Bus: EtherCATReceivedFromSOMANET[1 4]
  receivedFromInputDevice: Bus: EtherCATReceivedFromInputDevice
  receivedFromGESs: Bus: EtherCATReceivedFromGES
  receivedFromPowerElectronics: Bus: EtherCATReceivedFromPowerElectronics
  sendToSOMANETs: Bus: EtherCATSendToSOMANET[1 4]
  sendToInputDevice: Bus: EtherCATSendToInputDevice
  sendToPowerElectronics: Bus: EtherCATSendToPowerElectronics

maxTemperatureJoint = Simulink.Parameter(100, Unit="Celcius")
maxTemperatureSomanet = Simulink.Parameter(60)

DeviceErrors = Simulink.Bus()
  errorSOMANETs: Enum: SomanetError[1 4]
  errorInputDevice: Enum: EthercatDeviceError
  errorPowerElectronics: Bus: PowerElectronicsError
  errorGES: Bus: GESErrors

JointDynamicCommand = Simulink.Bus()
  jointDynamics: Bus: JointDynamics
  jointCommand: Enum: JointCommand

EtherCATReceivedFromSOMANET = Simulink.Bus()
  statusword: double
  actualAngle: double
  actualVelocity: double
  actualTorque: double
  userMISO: double
  tuningStatus: double
  errorSOMANET: double
  statusPhaseCurrentB: double
  statusPhaseCurrentC: double
  opMode: double
  statusTemperature: double
  timestamp: double
  actualMotorAngle: double
  actualMotorVelocity: double

resolutionMotorEncoder = Simulink.Parameter(4096)

standUpHip = [0 92
 0.01332178 92.00001
 0.02664355 92.00003
 0.03996533 92.00008
 0.0532871 92.00014
 0.06660888 92.00021
 0.07993066 92.00031
 0.09325243 92.00042
 0.1065742 92.00054
 0.119896 92.00069
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 ]

standUpKnee = [0 90
 0.01332178 90
 0.02664355 90
 0.03996533 90
 0.0532871 90
 0.06660888 90
 0.07993066 90
 0.09325243 90
 0.1065742 90
 0.119896 90
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 ]

sitDownHip = [0 2
 0.03997599 1.99999
 0.07995198 1.999962
 0.119928 1.999918
 0.159904 1.999859
 0.19988 1.999788
 0.2398559 1.999705
 0.2798319 1.999613
 0.3198079 1.999514
 0.3597839 1.999409
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 ]

sitDownKnee = [0 2
 0.03997599 1.99999
 0.07995198 1.999962
 0.119928 1.999918
 0.159904 1.999859
 0.19988 1.999788
 0.2398559 1.999705
 0.2798319 1.999613
 0.3198079 1.999514
 0.3597839 1.999409
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 ]

sampleTime = 0.002
sampleTimeSimulink = Simulink.Parameter(0.002)

EtherCATReceivedFromGESBack = Simulink.Bus()
  temperatureRHFE: double
  temperatureLHFE: double

EtherCATReceivedFromGES = Simulink.Bus()
  receivedFromGESLKFE: Bus: EtherCATReceivedFromGESJoint
  receivedFromGESRKFE: Bus: EtherCATReceivedFromGESJoint
  receivedFromGESBack: Bus: EtherCATReceivedFromGESBack

GESErrors = Simulink.Bus()
  errorGESLKFE: Enum: GESError
  errorGESRKFE: Enum: GESError
  errorGESBack: Enum: GESError

GaitPhases = Simulink.Bus()
  phaseRightLeg: double
  phaseLeftLeg: double

motorResistance = Simulink.Parameter(0.2)  % Motor Resistance in Ohms. See https://confluence.projectmarch.nl:8443/display/05TECH/Instantaneous+phase+current+to+power+supply+current
backEMFConstant = Simulink.Parameter(131.2)  % BackEMF Constant, in RPM/V. See https://confluence.projectmarch.nl:8443/display/05TECH/Instantaneous+phase+current+to+power+supply+current
motorTransmissionRatio = Simulink.Parameter(100)  % Motor turns/joint turn

EtherCATSendToSOMANET = Simulink.Bus()
  tuningCommand: double
  userMOSI: double
  targetAngle: double
  targetVelocity: double
  targetTorque: double
  controlword: Enum: SomanetControlWord
  opMode: Enum: SomanetOpmode
  maxTorque: double

MiscDataSOMANET = Simulink.Bus()
  jointControlConfigs: Bus: JointControlConfig[1 4]
  somanetData: Bus: SOMANETData[1 4]

currentNominal = Simulink.Parameter(20, Unit="A")

SOMANETData = Simulink.Bus()
  somanetState: Enum: SomanetState
  controlState: Enum: SomanetControlState
  opMode: Enum: SomanetOpmode
  somanetError: Enum: SomanetError
  positionKp: double
  positionKi: double
  positionKd: double
  phaseAmplitude: double
  electricPower: double
  surfaceI2t: double

ExoskeletonData = Simulink.Bus()
  etherCATData: Bus: EtherCATData
  error: Bus: DeviceErrors
  gaitPhase: Bus: GaitPhases
  masterState: Enum: ExoskeletonState
  miscDataSOMANETs: Bus: MiscDataSOMANET
  actualDynamics: Bus: JointDynamics[1 4]
  targetDynamics: Bus: JointDynamics[1 4]

stepSwingLegHip = [0 2
 0.0333111 2.000401
 0.06662221 2.001602
 0.09993331 2.0036
 0.1332444 2.006392
 0.1665555 2.009975
 0.1998666 2.014346
 0.2331777 2.019501
 0.2664888 2.025439
 0.2997999 2.032155
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 ]

stepSwingLegKnee = [0 2
 0.0333111 2.000053
 0.06662221 2.000211
 0.09993331 2.000475
 0.1332444 2.000844
 0.1665555 2.001317
 0.1998666 2.001896
 0.2331777 2.00258
 0.2664888 2.003367
 0.2997999 2.00426
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 ]

stepStandLegKnee = [0 2
 0.0333111 2.000053
 0.06662221 2.000211
 0.09993331 2.000475
 0.1332444 2.000844
 0.1665555 2.001317
 0.1998666 2.001896
 0.2331777 2.00258
 0.2664888 2.003367
 0.2997999 2.00426
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 ]

stepStandLegHip = [0 2
 0.0333111 2.000401
 0.06662221 2.001602
 0.09993331 2.0036
 0.1332444 2.006392
 0.1665555 2.009975
 0.1998666 2.014346
 0.2331777 2.019501
 0.2664888 2.025439
 0.2997999 2.032155
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 ]